# Grasshopper definition wall_generator.gh (Grasshopper 1.0.8)

brep = Brep(<brep referenced from the Rhino model>)
debrep = DeconstructBrep(Brep=brep)  # -> Faces, Edges, Vertices
py3 = Python3Script(
    footprint_d=Slider(10, range=0..10),
    footprint_w=Slider(10, range=0..10),
    height=Slider(9, range=0..10),
    floors=Slider(3, range=0..10),
    description="modern office building",
    pts=debrep.Vertices,
    win_ratio=Slider(0.4, range=0..1),
    wall_t=Slider(0.2, range=0..1))  # -> walls, windows, roof; inputs pts: list of Point3d
# ---------- py3: Python ----------
import rhinoscriptsyntax as rs
import Rhino.Geometry as rg
import math
import json

# Only call API if description is provided
if description and len(description) > 0:
    import urllib.request
    
    # Build request to FastAPI
    url = "http://localhost:8000/generate-building"
    data = json.dumps({
        "description": description,
        "floors": floors,
        "height": float(height),
        "footprint_width": float(footprint_w),
        "footprint_depth": float(footprint_d)
    }).encode("utf-8")
    
    req = urllib.request.Request(
        url,
        data=data,
        headers={"Content-Type": "application/json"},
        method="POST"
    )
    
    try:
        with urllib.request.urlopen(req) as response:
            result = json.loads(response.read().decode("utf-8"))
            win_ratio = result["window_ratio"]
            wall_t = result["wall_thickness"]
            print("AI parameters received:", result)
    except Exception as e:
        print("API error, using slider values:", str(e))
        # Fall back to slider values if API fails

# pts is a proper list of Point3d objects
point_list = pts

# Get all unique Z levels
z_levels = sorted(set(round(p.Z, 2) for p in point_list))
print("Z levels found:", z_levels)

if len(z_levels) < 2:
    print("Need at least 2 floor levels")
else:
    ground_pts = [p for p in point_list if round(p.Z, 2) == z_levels[0]]
    cx = sum(p.X for p in ground_pts) / len(ground_pts)
    cy = sum(p.Y for p in ground_pts) / len(ground_pts)
    sorted_pts = sorted(ground_pts, key=lambda p: math.atan2(p.Y - cy, p.X - cx))
    
    corner_pts = [rg.Point3d(p.X, p.Y, z_levels[0]) for p in sorted_pts]
    corner_pts.append(corner_pts[0])
    footprint = rg.PolylineCurve([rg.Point3d(p) for p in corner_pts])
    
    wall_list = []
    window_list = []
    
    for i in range(len(z_levels) - 1):
        z_bottom = z_levels[i]
        z_top = z_levels[i + 1]
        floor_height = z_top - z_bottom
        
        polyline = footprint.ToPolyline()
        segments = polyline.GetSegments()
        
        for seg in segments:
            pt_a = rg.Point3d(seg.From.X, seg.From.Y, z_bottom)
            pt_b = rg.Point3d(seg.To.X, seg.To.Y, z_bottom)
            pt_c = rg.Point3d(seg.To.X, seg.To.Y, z_top)
            pt_d = rg.Point3d(seg.From.X, seg.From.Y, z_top)
            
            wall_srf = rg.NurbsSurface.CreateFromCorners(pt_a, pt_b, pt_c, pt_d)
            wall_list.append(wall_srf)
            
            seg_len = seg.Length
            if seg_len > 0:
                win_width = seg_len * win_ratio * 0.8
                win_height = floor_height * win_ratio * 0.8
                mid_x = (pt_a.X + pt_b.X) / 2
                mid_y = (pt_a.Y + pt_b.Y) / 2
                win_z_bottom = z_bottom + floor_height * 0.3
                win_z_top = win_z_bottom + win_height
                dx = (pt_b.X - pt_a.X) / seg_len
                dy = (pt_b.Y - pt_a.Y) / seg_len
                w_pt_a = rg.Point3d(mid_x - dx * win_width/2, mid_y - dy * win_width/2, win_z_bottom)
                w_pt_b = rg.Point3d(mid_x + dx * win_width/2, mid_y + dy * win_width/2, win_z_bottom)
                w_pt_c = rg.Point3d(mid_x + dx * win_width/2, mid_y + dy * win_width/2, win_z_top)
                w_pt_d = rg.Point3d(mid_x - dx * win_width/2, mid_y - dy * win_width/2, win_z_top)
                win_srf = rg.NurbsSurface.CreateFromCorners(w_pt_a, w_pt_b, w_pt_c, w_pt_d)
                window_list.append(win_srf)
    
    top_pts = [rg.Point3d(p.X, p.Y, z_levels[-1]) for p in sorted_pts]
    top_pts.append(top_pts[0])
    roof_curve = rg.PolylineCurve([rg.Point3d(p) for p in top_pts])
    roof_srf = rg.Brep.CreatePlanarBreps(roof_curve, 0.01)
    
    walls = wall_list
    windows = window_list
    roof = roof_srf
# ---------- end py3 ----------
